# Grasshopper definition floor.gh (Grasshopper 1.0.8)

construct_point = ConstructPoint(XCoordinate="1", YCoordinate=0, ZCoordinate=0)
vector_xyz = VectorXYZ(XComponent="2", YComponent="1", ZComponent="3")  # -> Vector, Length
vector_xyz_2 = VectorXYZ(XComponent="16", YComponent="16", ZComponent="4")  # -> Vector, Length
construct_point_2 = ConstructPoint(XCoordinate="0", YCoordinate="0", ZCoordinate="0")
move = Move(Geometry=construct_point, Motion=vector_xyz.Vector)  # -> Geometry, Transform
move_2 = Move(Geometry=construct_point_2, Motion=vector_xyz_2.Vector)  # -> Geometry, Transform
line = Line(StartPoint=construct_point_2)
point = Point(Point(7.6243009, 7.876726534, 0))
box_2pt = Box2Pt(PointA=construct_point_2, PointB=move_2.Geometry, Plane=PlaneXY(0, 0, 0))
box_2pt_2 = Box2Pt(PointA=construct_point, PointB=move.Geometry, Plane=PlaneXY(0, 0, 0))
curve_array = CurveArray(Geometry=box_2pt_2, Curve=line, Count=10)  # -> Geometry, Transform
edges_from_faces = EdgesFromFaces(Brep=box_2pt, Points=point)  # -> Edges, Indices
solid_difference = SolidDifference(BrepsA=box_2pt)
